# Grasshopper definition 20250618_线与内部点遍历对应.gh (Grasshopper 1.0.8)
# plug-ins: RhinoCodePluginGH

point = Point([<point referenced from the Rhino model> x440])
curve = Curve([<curve referenced from the Rhino model> x460])
python_3_script = Python3Script(Points=point, Curves=curve)  # -> out, out_tree, out_remaining; inputs Points: list of Point3d, Curves: list of Curve
# ---------- python_3_script: Python ----------
import System
from System.Collections.Generic import List
import Rhino
import Grasshopper as gh
from Grasshopper.Kernel.Data import GH_Path
from Grasshopper import DataTree
import Rhino.Geometry as rg
import ghpythonlib.treehelpers as gt

def match_curves_points(Curves, Points):
    matched_pairs = []  
    
    for curve in Curves:
        if not curve.IsClosed:  # 以防万一，保证曲线封闭
            continue
            
        matched_point = None
        for pt in Points:
            containment = curve.Contains(pt)
            # 点是否在曲线内部或边界
            if containment in (rg.PointContainment.Inside, rg.PointContainment.Coincident):
                matched_point = pt
                break  # 找到即停止，默认只有一个
        
        if matched_point:
            # 记录匹配对并从原始list中移除该点
            matched_pairs.append([curve, matched_point])
            Points.remove(matched_point) 
    
    return matched_pairs, Points

def create_data_tree(pairs):
    """将匹配对转换为Grasshopper树结构"""
    tree = DataTree[object]()
    for idx, (curve, point) in enumerate(pairs):
        path = GH_Path(idx)
        tree.Add(curve, path)
        tree.Add(point, path)
    return tree


if __name__ == "__main__":
    matched_pairs, remaining_points = match_curves_points(Curves, Points)
    result_tree = create_data_tree(matched_pairs)
    out_tree = result_tree   
    out_remaining = remaining_points
# ---------- end python_3_script ----------
group = Group(Objects=python_3_script.out_tree)  # -> flatten(Group)
data = Data(python_3_script.out_tree)
list_item = ListItem(List=group, Index=Slider(37, range=0..100), Wrap=True)
